vi "index.gviweb"   [G Web Development Software 22.3.0]
# Press “Analyse” and select a service report xml file
panel controls:
  "Analyse": bool  # Press the button “Analyse” and select a service report xml file.
  "Page 1": i32
  "Page selector": enum{"Page 1", "Page 2", "Page 3", "Page 4"} = "Page 1"
  "Page 2": i32
  "Page 3": i32
  "Page 4": i32
  "Device": enum{"iCombi Pro/iHexagon", "iVario"} = "iCombi Pro/iHexagon"
  "ivario": i32
  "Info_Plot": bool
  "Sort table ivario": bool
  "Sort table iCombi": bool
  "Page content": bool
  "Engine Link": string = "https://portal.rational-online.com/fs4p/media/service/3_dokumentationen/icombi_pro___icombi_classik/tm_icombi_pro___icombi_classic/en_gb/80.51.321_ET_en-GB.pdf"
  "Changed Component": string[]
  "Error_Selektor": enum{"All data", "Relevant data", "Error view"} = "Relevant data"
  "Device:_2": string = "No_Picture.jpg"
  "Board Information:_2": cluster{"Board": string, "Information": string}[]
  "common_2": T1[]
  "Basic_Settings_2": T2[]
  "Diagnostic_RT_Data_Sensors_2": T9[]
  "Diagnostic RT Calibration_2": T3[]
  "Checkbox_2": bool
  "Diagnostic_Water_iCS_Switch_2": T4[]
  "Diagnostic-Service-History_2": T5[]
  "Sort table iCombi_2": bool
  "Engine Link_2": string = "https://portal.rational-online.com/fs4p/media/service/3_dokumentationen/icombi_pro___icombi_classik/tm_icombi_pro___icombi_classic/en_gb/80.51.321_ET_en-GB.pdf"
  "Diagnostic Running Times Comp_2": T6[]
  "Total Running Time :_2": T6[]
  "Software-Service-History_iCP_2": T11[]
panel indicators:
  "Device:": string
  "Board Information:": cluster{"Board": string, "Information": string}[]
  "common": T1[]
  "URL-Grafik": string
  "Basic_Settings": T2[]
  "Diagnostic RT Calibration": T3[]
  "Checkbox": bool
  "Diagnostic_Water_iCS_Switch": T4[]
  "Diagnostic-Service-History": T5[]
  "Diagnostic Running Times Comp": T6[]
  "Diagnostic Running Times Modes": T6[]
  "System Logger Output": T7[]
  "Histogram cpu pcb Temperature profile Celsius": f64[]
  "skala histogram CPU": string
  "Histogram IO Temperature profile Celsius": f64[]
  "skala histogram IO": string
  "Histogram LED hinge side Temperature profile Celsius": f64[]
  "skala Histogram LED hinge": string
  "Histogram LED handle side Temperature profile Celsius": f64[]
  "Skala Histogram LED handle": string
  "Histogram pump pcb Temperature profile Celsius": f64[]
  "skala Histogram pump pcb": string
  "Histogram gas box Temperature profile Celsius": f64[]
  "Skala Histogram Gas box": string
  "Histogram fan 1 RPM profile 1 min": f64[]
  "skala Histogram fan 1 rpm": string
  "Histogram fan 1 power profile W": f64[]
  "Skala Histogram fan power": string
  "Histogram fan 1 Temperature_profile Celsius": f64[]
  "Skala Histogram fan1 temp": string
  "Histogram fan 1 Voltage max_V_1phase_3phase": f64[]
  "Skala Histogram fan1 max Volt": string
  "Histogram fan 1 Voltage min_V_1phase_3phase": f64[]
  "Skala Histogram fan1 minVolt": string
  "Histogram fan 2 RPM profile 1 min": f64[]
  "skala Histogram fan 2 rpm": string
  "Histogram fan 2 power profile W": f64[]
  "Skala Histogram fan2 power": string
  "Histogram fan 2 Temperature_profile Celsius": f64[]
  "Skala Histogram fan2 temp": string
  "Histogram fan 2 Voltage max_V_1phase_3phase": f64[]
  "Histogram fan 2 Voltage min_V_1phase_3phase": f64[]
  "Skala Histogram fan2 minVolt": string
  "Skala Histogram fan2 maxVolt": string
  "Histogram fan 3 RPM profile 1 min": f64[]
  "skala Histogram fan 3 rpm": string
  "Histogram fan 3 power profile W": f64[]
  "Skala Histogram fan3 power": string
  "Histogram fan 3 Temperature_profile Celsius": f64[]
  "Skala Histogram fan3 temp": string
  "Histogram fan 3 Voltage max_V_1phase_3phase": f64[]
  "Histogram fan 3 Voltage min_V_1phase_3phase": f64[]
  "Skala Histogram fan3 minVolt": string
  "Skala Histogram fan3 maxVolt": string
  "Histogram MMI CPU Load Percent": f64[]
  "Skala Histogram MMI CPU": string
  "Histogram MMI RAM Load Percent": f64[]
  "Skala Histogram MMI Load": string
  "Histogram Basis CPU Load Percent": f64[]
  "Skala Histogram Basis MMI CPU": string
  "Histogram Basis RAM Load Percent": f64[]
  "Skala Histogram Basis MMI Load": string
  "Histogram Magnetron Top Temperatur profile Celsius": f64[]
  "skala Magnetron top": string
  "Histogram Magnetron bottom Temperature profile Celsius": f64[]
  "skala Magnetron bottom": string
  "Histogram Power Supply Top Temperature profile Celsius": f64[]
  "skala Power Supply top": string
  "Histogram Power Supply bottom Temperature profile Celsius": f64[]
  "skala histogram Power Supply bottom": string
  "Boards_Information:": cluster{"Board": string, "Information": string}[]
  "Device :": string
  "common Information ivario": T1[]
  "Basic Informations": T2[]
  "Diagnostic_RT_Data_Sensors_Heating": T8[]
  "Diagnostic_RT_Data_Sensors": T9[]
  "Diagnostic_RT_Data_Sensors_mouvement": T10[]
  "Diagnostic_RT_Data_Sensors_Pressure": T4[]
  "Diagnostic-Service-History_iVario": T5[]
  "Total Running Time:": T6[]
  "Diagnostic Running Times Components:": T6[]
  "String": string
  "Total Running Time :": T6[]
  "Measured_temperature IO °C [Min/Max]:": f64[]
  "wrong unit type": bool
  "Software-Service-History_iCP": T11[]
  "Software-Service-History_iVario": T11[]
  "Component Replacement History": T12[]
  "add BMK to common information": bool
  "Tabs with errors": string
  "Common Information_Error": string
  "Basic_Settings_Error": string
  "Diagnostic Real Time Data Sensors": string
  "Diagnostic RT Calibration_Text": string
  "Diagnostic Water iCS Switch Text": string
  "Diagnostic Service History Text": string
  "Diagnostic RunningTimes mode": string
  "Diagnostic Running Time Components": string
  "System Logger_Text": string
  "Service report XML File Content:": string
  "System OnOff History": T13[]
types:
  T1 = cluster{"Parameter Name": string, "Value": string, "Comment": string}
  T2 = cluster{"Parameter Name": string, "Value": string, "Dimension": string, "Comment": string}
  T3 = cluster{"Parameter Name": string, "Combi": string, "Dry": string, "Wet": string, "Dimension": string, "Comment": string}
  T4 = cluster{"Parameter Name": string, "Status": string, "Dimension": string, "Comment": string}
  T5 = cluster{"Parameter Name": string, "First Time": string, "Last Time": string, "Quantity": string, "Comment": string}
  T6 = cluster{"Parameter Name": string, "Count": string, "Duration": string, "Dimension": string, "Comment": string}
  T7 = cluster{"Parameter Name": string, "Value": string, "Value relative": string, "Dimension": string, "Comment": string}
  T8 = cluster{"Parameter Name": string, "Actual": string, "Dimension": string, "Comment": string}
  T9 = cluster{"Parameter Name": string, "Actual": string, "Dimension": string, "Limit": string, "maximum": string, "Element 6": string, "Element 7": string}
  T10 = cluster{"Parameter Name": string, "Command": string, "Down_Switch": string, "Status": string, "Up_Switch": string, "Dimension": string, "Comment": string}
  T11 = cluster{"Parameter Name": string, "Update Date": string, "Version Name": string}
  T12 = cluster{"Replacement number": string, "BMK": string, "Component name": string, "Replace time": string, "Serial number": string, "Service note": string, "Type": string}
  T13 = cluster{"Parameter Name": string, "OnOffEvent": string, "Reason": string, "Time": string}
  T14 = cluster{"Parameter Name": string, "Combi": string, "Dry": string}
  T15 = cluster{"Parameter Name": string, "Status": string, "Dimension": string, "comment": string}
  T16 = cluster{"Boards": string, "Informations": string}
  T17 = cluster{"Parameter Name": string, "Actual": string, "Dimension": string, "Limit": string, "maximum": string, "Time_stamp": string, "Comment": string}
  T18 = cluster{"Parameter Name": string, "Actual": string, "Dimension": string, "comment": string}
  T19 = cluster{"Parameter Name": string, "Command": string, "Down_Switch": string, "Status": string, "Up_Switch": string, "dim": string, "Comment": string}
uses:
  NI::HTTP::GET.gvi
  Uppy::Function.gvi
  FileTasks::Read File Text.gvi
  NI::G Core::Error::Clear Error Cluster.gvi
  Library::Check_XML_Device.gviweb
  WebApp::Sort_Service_History_event.gviweb
  WebApp::Read_XML_Part.gviweb
  WebApp::Exlude_WA_Entrys.gviweb
  WebApp::Interpret_Common_Information.gviweb
  WebApp::Sort_Common_Infomation.gviweb
  WebApp::Interpret_Common_Information_iVario.gviweb
  WebApp::Interpret_Basic_Settings.gviweb
  WebApp::Sort_Basic_Settings.gviweb
  WebApp::Exclude_iVario_Entry.gviweb
  WebApp::Interpret_Basic_Settings_iVario.gviweb
  WebApp::Interpret_Diagnostic_RT_Data_Sensors.gviweb
  WebApp::Sort_Diagnostic_Real_Time_Data_Sensors.gviweb
  WebApp::Interpret_Diagnostic_RT_Data_Sensors_Heating.gviweb
  WebApp::Interpret_Diagnostic_RT_Data_Sensors_Movement.gviweb
  WebApp::Interpret_Diagnostic_RT_Data_Sensors_Pressure.gviweb
  WebApp::Interpret_Diagnostic_RT_Calibration.gviweb
  WebApp::Sort_Diagnostic_RT_Calibration.gviweb
  WebApp::Interpret_Diagnostic_Water_iCS_Switch.gviweb
  WebApp::Sort_Diagnostic_Water_iCs_Switch.gviweb
  WebApp::Diagnostic_Service_History.gviweb
  WebApp::Sort_Diagnostic_Service_History.gviweb
  WebApp::Interpret_Software_Version_History.gviweb
  WebApp::Interpret_System_OnOff_History.gviweb
  WebApp::Interpret_Component_Replacement_History.gviweb
  WebApp::Sort_Service_History_MSGs_Default.gviweb
  WebApp::Interpret_Diagnostic_RunningTimes_Comp.gviweb
  WebApp::Sort_RunningTimes_Components.gviweb
  WebApp::Interpret_SystemLogger.gviweb
  WebApp::Sort_System_Logger.gviweb
  WebApp::Interpret_Histogram_CPU_IO_Temperature.gviweb
  NI::G Core::Strings::Trim Whitespace.gvi
  NI::G Core::Strings::Search and Replace Pattern.gvi
  WebApp::Interpret_Diagnostic_RunningTimes_Modes.gviweb
  WebApp::Sort_Diagnostic_RunningTimes_Modes.gviweb
diagram:
  # "": Auto Dose available
  # "": Unit-Type
  w1 = "Init"  # State
  s1 = w1  # shift register
  s2 = ""  # shift register
  s3 = string[] []  # shift register
  s4 = ""  # shift register
  s5 = ""  # shift register
  s6 = ""  # shift register
  s7 = ""  # shift register
  while {
    case (s1) {
      frame "Init", Default {
        $"Skala Histogram fan1 temp" <- "skala_fan_temp.jpg"
        $"skala Histogram pump pcb" <- "skala_120.jpg"
        w10 = "Read Ini File"  # State
        $"skala histogram IO" <- "skala_120.jpg"
        $"Skala Histogram fan2 temp" <- "skala_fan_temp.jpg"
        $"skala histogram CPU" <- "skala_120.jpg"
        $"Skala Histogram fan3 temp" <- "skala_fan_temp.jpg"
        $"Device:" <- "No_Picture.jpg"
        $"skala Histogram LED hinge" <- "skala_120.jpg"
        $"Skala Histogram fan2 power" <- "skala_fan_Puis.jpg"
        $"URL-Grafik" <- "Rational_Logo.png"
        $"Skala Histogram LED handle" <- "skala_120.jpg"
        $"Skala Histogram fan power" <- "skala_fan_Puis.jpg"
        $"Skala Histogram Gas box" <- "skala_120.jpg"
        $"Skala Histogram fan3 power" <- "skala_fan_Puis.jpg"
        $"Skala Histogram fan3 minVolt" <- "skala_fan_voltage.jpg"
        $"Skala Histogram fan1 minVolt" <- "skala_fan_voltage.jpg"
        $"skala Histogram fan 3 rpm" <- "skala_fan_RPM.jpg"
        $"Skala Histogram Basis MMI Load" <- "skala_MMI.jpg"
        $"skala Magnetron top" <- "skala_120.jpg"
        $"Skala Histogram fan1 max Volt" <- "skala_fan_voltage.jpg"
        $"skala Histogram fan 1 rpm" <- "skala_fan_RPM.jpg"
        $"skala Power Supply top" <- "skala_120.jpg"
        $"Skala Histogram Basis MMI CPU" <- "skala_MMI.jpg"
        $"Skala Histogram fan2 minVolt" <- "skala_fan_voltage.jpg"
        $"skala Histogram fan 2 rpm" <- "skala_fan_RPM.jpg"
        $"skala Magnetron bottom" <- "skala_120.jpg"
        $"Skala Histogram MMI CPU" <- "skala_MMI.jpg"
        $"Skala Histogram fan2 maxVolt" <- "skala_fan_voltage.jpg"
        $"skala histogram Power Supply bottom" <- "skala_120.jpg"
        $"Skala Histogram MMI Load" <- "skala_MMI.jpg"
        $"Skala Histogram fan3 maxVolt" <- "skala_fan_voltage.jpg"
        Property Node(instance in=reference to "Tabs with errors", "Visible"=FALSE, error in=no error) -> (error out=w11, instance out=w12)
        Close Reference(error in=w11, reference=w12) -> (error out=w13)
        Property Node(instance in=reference to "Device", "Value"="iCombi Pro/iHexagon", error in=w13) -> (error out=w14, instance out=w15)
        Close Reference(error in=w14, reference=w15) -> (error out=w16)
        Property Node(instance in=reference to "String", "Visible"=FALSE, error in=w16) -> (error out=w17, instance out=w18)
        Close Reference(error in=w17, reference=w18) -> (error out=w19)
        Property Node(instance in=reference to "Page 1", "Visible"=TRUE, error in=w19) -> (error out=w20, instance out=w21)
        Property Node(instance in=reference to "Page 2", "Visible"=FALSE, error in=w20) -> (error out=w22, instance out=w23)
        Property Node(instance in=reference to "Page 3", "Visible"=FALSE, error in=w22) -> (error out=w24, instance out=w25)
        Property Node(instance in=reference to "Page 4", "Visible"=FALSE, error in=w24) -> (error out=w26, instance out=w27)
        Property Node(instance in=reference to "ivario", "Visible"=FALSE, error in=w26) -> (error out=w28, instance out=w29)
        Property Node(instance in=reference to "Page content", "Visible"=TRUE, error in=w28) -> (error out=w30, instance out=w31)
        Close Reference(error in=w30, reference=w21) -> (error out=w32)
        Close Reference(error in=w32, reference=w23) -> (error out=w33)
        Close Reference(error in=w33, reference=w25) -> (error out=w34)
        Close Reference(error in=w34, reference=w27) -> (error out=w35)
        Close Reference(error in=w35, reference=w29) -> (error out=w36)
        Close Reference(error in=w36, reference=w31) -> (error out=w2)
        w3 = w10
        w4 = s2
        w5 = s3
        w6 = s4
        w7 = s5
        w8 = s6
        w9 = s7
      }
      frame "Reset all" {
        case ($"wrong unit type") {
          frame True { }
          frame False {
            $"Device :" <- "No_Picture.jpg"
            $"Device:" <- "No_Picture.jpg"
            $common <- T1[] []
            $"common Information ivario" <- T1[] []
          }
        }
        $"Total Running Time :" <- T6[] []
        $"Software-Service-History_iCP" <- T14[] []
        $"Diagnostic Running Times Modes" <- T6[] []
        $"Software-Service-History_iVario" <- T14[] []
        $"Total Running Time:" <- T6[] []
        $"System Logger Output" <- T7[] []
        $Checkbox <- FALSE
        $"Diagnostic Running Times Components:" <- T6[] []
        $"Diagnostic RT Calibration" <- T3[] []
        w37 = "Wait For Interaction"  # State
        $"Histogram Basis RAM Load Percent" <- f64[] []
        $"Diagnostic Running Times Comp" <- T6[] []
        $"Histogram Basis CPU Load Percent" <- f64[] []
        $Diagnostic_RT_Data_Sensors_Pressure <- T15[] []
        $"Histogram MMI RAM Load Percent" <- f64[] []
        $"Diagnostic-Service-History" <- T5[] []
        $"Basic Informations" <- T2[] []
        $"Histogram MMI CPU Load Percent" <- f64[] []
        $"Boards_Information:" <- T16[] []
        $Diagnostic_Water_iCS_Switch <- T4[] []
        $Basic_Settings <- T2[] []
        $"Histogram fan 3 power profile W" <- f64[] []
        $"Board Information:" <- T16[] []
        $Diagnostic_RT_Data_Sensors <- T17[] []
        $"Diagnostic-Service-History_iVario" <- T5[] []
        $Diagnostic_RT_Data_Sensors_Heating <- T18[] []
        $Diagnostic_RT_Data_Sensors_mouvement <- T19[] []
        case ($Device) {
          frame "iCombi Pro/iHexagon", Default {
            for (N = 4) (iteration -> i1) {
              case (i1) {
                frame 0, Default {
                  Property Node(instance in=reference to "Page 1", "Value"=i1, "Visible"=TRUE, error in=no error) -> (error out=w38, instance out=w39)
                  Close Reference(error in=w38, reference=w39) -> (error out=w2)
                }
                frame 1 {
                  Property Node(instance in=reference to "Page 2", "Value"=i1, "Visible"=FALSE, error in=no error) -> (error out=w40, instance out=w41)
                  Close Reference(error in=w40, reference=w41) -> (error out=w2)
                }
                frame 2 {
                  Property Node(instance in=reference to "Page 3", "Value"=i1, "Visible"=FALSE, error in=no error) -> (error out=w42, instance out=w43)
                  Close Reference(error in=w42, reference=w43) -> (error out=w2)
                }
                frame 3 {
                  Property Node(instance in=reference to "Page 4", "Value"=i1, "Visible"=FALSE, error in=no error) -> (error out=w44, instance out=w45)
                  Close Reference(error in=w44, reference=w45) -> (error out=w2)
                }
              }
            }
          }
          frame "iVario" {
            Property Node(instance in=reference to "ivario", "Value"=0, error in=no error) -> (error out=w46, instance out=w47)
            Close Reference(error in=w46, reference=w47) -> (error out=w2)
          }
        }
        $"Histogram fan 1 Voltage min_V_1phase_3phase" <- f64[] []
        $"Histogram fan 1 Voltage max_V_1phase_3phase" <- f64[] []
        $"Histogram fan 3 RPM profile 1 min" <- f64[] []
        $"Histogram fan 1 Temperature_profile Celsius" <- f64[] []
        $"Histogram fan 2 RPM profile 1 min" <- f64[] []
        $"Histogram fan 3 Voltage min_V_1phase_3phase" <- f64[] []
        $"Histogram fan 2 power profile W" <- f64[] []
        $"Histogram fan 1 power profile W" <- f64[] []
        $"Histogram fan 3 power profile W" <- f64[] []
        $"Histogram gas box Temperature profile Celsius" <- f64[] []
        $"Histogram fan 3 Temperature_profile Celsius" <- f64[] []
        $"Histogram fan 1 RPM profile 1 min" <- f64[] []
        $"Histogram fan 2 Temperature_profile Celsius" <- f64[] []
        $"Histogram pump pcb Temperature profile Celsius" <- f64[] []
        $"Histogram cpu pcb Temperature profile Celsius" <- f64[] []
        $"Histogram fan 2 Voltage max_V_1phase_3phase" <- f64[] []
        $"Histogram LED handle side Temperature profile Celsius" <- f64[] []
        $"Histogram IO Temperature profile Celsius" <- f64[] []
        $"Histogram LED hinge side Temperature profile Celsius" <- f64[] []
        w3 = w37
        w4 = s2
        w5 = s3
        w6 = s4
        w7 = s5
        w8 = s6
        w9 = s7
      }
      frame "Change Page" {
        w48 = "Wait For Interaction"  # State
        case ($"Page selector") {
          frame "Page 1", Default {
            Property Node(instance in=reference to "Page 2", "Visible"=FALSE, error in=no error) -> (error out=w54, instance out=w50)
            Property Node(instance in=reference to "Page 1", "Visible"=TRUE, error in=w54) -> (error out=w55, instance out=w51)
            Property Node(instance in=reference to "Page 3", "Visible"=FALSE, error in=w55) -> (error out=w56, instance out=w52)
            Property Node(instance in=reference to "Page 4", "Visible"=FALSE, error in=w56) -> (error out=w49, instance out=w53)
          }
          frame "Page 2" {
            Property Node(instance in=reference to "Page 2", "Visible"=TRUE, error in=no error) -> (error out=w57, instance out=w50)
            Property Node(instance in=reference to "Page 1", "Visible"=FALSE, error in=w57) -> (error out=w58, instance out=w51)
            Property Node(instance in=reference to "Page 3", "Visible"=FALSE, error in=w58) -> (error out=w59, instance out=w52)
            Property Node(instance in=reference to "Page 4", "Visible"=FALSE, error in=w59) -> (error out=w49, instance out=w53)
          }
          frame "Page 3" {
            Property Node(instance in=reference to "Page 2", "Visible"=FALSE, error in=no error) -> (error out=w60, instance out=w50)
            Property Node(instance in=reference to "Page 1", "Visible"=FALSE, error in=w60) -> (error out=w61, instance out=w51)
            Property Node(instance in=reference to "Page 3", "Visible"=TRUE, error in=w61) -> (error out=w62, instance out=w52)
            Property Node(instance in=reference to "Page 4", "Visible"=FALSE, error in=w62) -> (error out=w49, instance out=w53)
          }
          frame "Page 4" {
            Property Node(instance in=reference to "Page 2", "Visible"=FALSE, error in=no error) -> (error out=w63, instance out=w50)
            Property Node(instance in=reference to "Page 1", "Visible"=FALSE, error in=w63) -> (error out=w64, instance out=w51)
            Property Node(instance in=reference to "Page 3", "Visible"=FALSE, error in=w64) -> (error out=w65, instance out=w52)
            Property Node(instance in=reference to "Page 4", "Visible"=TRUE, error in=w65) -> (error out=w49, instance out=w53)
          }
        }
        Close Reference(error in=w49, reference=w50) -> (error out=w66)
        Close Reference(error in=w66, reference=w51) -> (error out=w67)
        Close Reference(error in=w67, reference=w52) -> (error out=w68)
        Close Reference(error in=w68, reference=w53) -> (error out=w2)
        w3 = w48
        w4 = s2
        w5 = s3
        w6 = s4
        w7 = s5
        w8 = s6
        w9 = s7
      }
      frame "Change Device" {
        w69 = "Wait For Interaction"  # State
        case ($Device) {
          frame "iCombi Pro/iHexagon", Default {
            Property Node(instance in=reference to "Page content", "Visible"=TRUE) -> (error out=w78, instance out=w77)
            Property Node(instance in=reference to "Page selector", "Visible"=TRUE, "Value"="Page 1", error in=w78) -> (error out=w79, instance out=w76)
            Property Node(instance in=reference to "ivario", "Visible"=FALSE, error in=w79) -> (error out=w80, instance out=w75)
            Property Node(instance in=reference to "Page 2", "Visible"=FALSE, error in=w80) -> (error out=w81, instance out=w71)
            Property Node(instance in=reference to "Page 1", "Visible"=TRUE, error in=w81) -> (error out=w82, instance out=w72)
            Property Node(instance in=reference to "Page 3", "Visible"=FALSE, error in=w82) -> (error out=w83, instance out=w73)
            Property Node(instance in=reference to "Page 4", "Visible"=FALSE, error in=w83) -> (error out=w70, instance out=w74)
          }
          frame "iVario" {
            Property Node(instance in=reference to "Page content", "Visible"=FALSE, error in=no error) -> (error out=w84, instance out=w77)
            Property Node(instance in=reference to "Page selector", "Visible"=FALSE, error in=w84) -> (error out=w85, instance out=w76)
            Property Node(instance in=reference to "ivario", "Visible"=TRUE, error in=w85) -> (error out=w86, instance out=w75)
            Property Node(instance in=reference to "Page 2", "Visible"=FALSE, error in=w86) -> (error out=w87, instance out=w71)
            Property Node(instance in=reference to "Page 1", "Visible"=FALSE, error in=w87) -> (error out=w88, instance out=w72)
            Property Node(instance in=reference to "Page 3", "Visible"=FALSE, error in=w88) -> (error out=w89, instance out=w73)
            Property Node(instance in=reference to "Page 4", "Visible"=FALSE, error in=w89) -> (error out=w70, instance out=w74)
          }
        }
        Close Reference(error in=w70, reference=w71) -> (error out=w90)
        Close Reference(error in=w90, reference=w72) -> (error out=w91)
        Close Reference(error in=w91, reference=w73) -> (error out=w92)
        Close Reference(error in=w92, reference=w74) -> (error out=w93)
        Close Reference(error in=w93, reference=w75) -> (error out=w94)
        Close Reference(error in=w94, reference=w76) -> (error out=w95)
        Close Reference(error in=w95, reference=w77) -> (error out=w2)
        w3 = w69
        w4 = s2
        w5 = s3
        w6 = s4
        w7 = s5
        w8 = s6
        w9 = s7
      }
      frame "Read Ini File" {
        w96 = "Wait For Interaction"  # State
        call "GET.gvi"(url="Config_XML_Datainterpreter.ini", error in=no error) -> (body=w97, error out=w98)
        call "Function.gvi"(string in=w97, Error Cluster Constant=w98) -> (Output=w5, Output_error=w2)
        w3 = w96
        w4 = s2
        w6 = s4
        w7 = s5
        w8 = s6
        w9 = s7
      }
      frame "Read XML File" {
        call "Read File Text.gvi"(allowed file types=[".xml"], error in=no error) -> (file content=w99, file name=w100, error out=w101)
        case (w101) {
          frame Error, Default {
            w102 = "Wait For Interaction"  # State
            call "Clear Error Cluster.gvi"(error in=w101) -> (error out=w2)
            w3 = w102
            w4 = ""
          }
          frame No Error {
            call "Clear Error Cluster.gvi"(error in=w101) -> (error out=w103)
            case ($Device) {
              frame "iVario" {
                call "Check_XML_Device.gviweb"(XML Name=w100, Error Input=w103, XML Content=w99, First Check="Pan", Second Check="Potentiometer", Sous-Fix="RAT") -> (Error Output=w104, XML fine ?=w105)
                case (w105) {
                  frame False, Default {
                    $"wrong unit type" <- FALSE
                    w106 = "Reset all"  # State
                    call "Check_XML_Device.gviweb"(XML Name=w100, Error Input=w104, XML Content=w99, First Check="Histogram", Second Check="CalibN1", Sous-Fix="RAG") -> (Error Output=w2, XML fine ?=w107)
                    case (w107) {
                      frame False, Default {
                        w108 = "The service report is invalid, please check the XML file you have opened"
                        One Button Dialog(message=w108)
                      }
                      frame True {
                        w109 = "Please select iCombi as device and reload the selected Service Report XML file !"
                        One Button Dialog(message=w109)
                      }
                    }
                    w3 = w106
                  }
                  frame True {
                    w110 = "Common Information iVario"  # State
                    w3 = w110
                    w2 = w104
                  }
                }
              }
              frame "iCombi Pro/iHexagon", Default {
                call "Check_XML_Device.gviweb"(XML Name=w100, Error Input=w103, XML Content=w99, First Check="Histogram", Second Check="CalibN1", Sous-Fix="RAG") -> (Error Output=w111, XML fine ?=w112)
                case (w112) {
                  frame False, Default {
                    $"wrong unit type" <- FALSE
                    w113 = "Reset all"  # State
                    call "Check_XML_Device.gviweb"(XML Name=w100, Error Input=w111, XML Content=w99, First Check="Pan", Second Check="Potentiometer", Sous-Fix="RAT") -> (Error Output=w2, XML fine ?=w114)
                    case (w114) {
                      frame False, Default {
                        w115 = "The service report is invalid, please check the XML file you have opened"
                        One Button Dialog(message=w115)
                      }
                      frame True {
                        w116 = "Please select iVario as device and reload the selected Service Report XML file !"
                        One Button Dialog(message=w116)
                      }
                    }
                    w3 = w113
                  }
                  frame True {
                    w117 = "Common Information"  # State
                    w3 = w117
                    w2 = w111
                  }
                }
              }
            }
            $"Service report XML File Content:" <- w99
            w4 = w99
          }
        }
        w5 = s3
        w6 = s4
        w7 = s5
        w8 = s6
        w9 = s7
      }
      frame "Wait For Interaction" {
        event {
          on "Analyse" Value changed {
            w118 = "Read XML File"  # State
            w2 = no error
            w3 = w118
          }
          on "Error_Selektor" Value changed {
            w119 = "Common Information"  # State
            w2 = no error
            w3 = w119
          }
          on "Page selector" Value changed {
            w120 = "Change Page"  # State
            w2 = no error
            w3 = w120
          }
          on "Device" Value changed {
            w121 = "Change Device"  # State
            w2 = no error
            w3 = w121
          }
          on "Info_Plot" Value changed {
            w122 = "Wait For Interaction"  # State
            Event Data() -> ("New Value"=w123)
            case (w123) {
              frame False, Default {
                Property Node(instance in=reference to "String", "Visible"=FALSE, error in=no error) -> (error out=w124, instance out=w125)
              }
              frame True {
                Property Node(instance in=reference to "String", "Visible"=TRUE, error in=no error) -> (error out=w124, instance out=w125)
                w126 = "Press the drop down menu under \"Plot\" \nand change the graph settings as desired."
                $String <- w126
              }
            }
            Close Reference(error in=w124, reference=w125) -> (error out=w2)
            w3 = w122
          }
          on "Page content" Value changed {
            w127 = "Wait For Interaction"  # State
            w128 = """Page contents:

Page 1: 
- Common Information.
- Basic Settings.
- Diagnostic Real Time Data Sensors.
- Diagnostic RT Calibration.
- Diagnostic Water iCS Switch.
- Diagnostic Service History.
- Diagnostic RunningTimes Components.
- Software Version History.

Page 2: 
- Histogram temperature CPU & IO.
- Diagnostic RunningTimes Modes.
- System Logger, Histogram temperature LEDs.
- Histogram temperature pump pcb & Gas box.
- Histogram temperature pump pcb & Histogram Fan 1 RPM & Power.
- Component Replacement History.

Page 3: 
- Histogram Fan1 Temp.&Voltages.
- Histogram Fan 2 RPM & Power.
- Histogram Fan2 Temp.&Voltages.
- Histogram Fan 3 RPM & Power.
- Histogram Fan3 Temp.&Voltages.
- Histogram MMI.
- System OnOff History.
     
Page 4: 
- Histogram Basis CPU & RAM Load, 
- Histogram Magnetron Temperature (iHexagon) & Power.
- Histogram Power Supply Temperature (iHexagon).
- Service report XML File Content."""
            One Button Dialog(message=w128)
            w2 = default
            w3 = w127
          }
          on "Sort table ivario" Value changed {
            w129 = "Wait For Interaction"  # State
            Event Data() -> ("Old Value"=w130)
            Not(x=w130) -> w131
            call "Sort_Service_History_event.gviweb"(Diagnostic Service History input=$"Diagnostic-Service-History_iVario", Event=w131, Error Cluster input=no error) -> (Diagnostic Service History output=w132, Error Output=w2)
            $"Diagnostic-Service-History_iVario" <- w132
            w3 = w129
          }
          on "Sort table iCombi" Value changed {
            w133 = "Wait For Interaction"  # State
            Event Data() -> ("Old Value"=w134)
            Not(x=w134) -> w135
            call "Sort_Service_History_event.gviweb"(Diagnostic Service History input=$"Diagnostic-Service-History", Event=w135, Error Cluster input=no error) -> (Diagnostic Service History output=w136, Error Output=w2)
            $"Diagnostic-Service-History" <- w136
            w3 = w133
          }
        }
        $"add BMK to common information" <- FALSE
        w4 = s2
        w5 = s3
        w6 = s4
        w7 = s5
        w8 = s6
        w9 = s7
      }
      frame "Common Information" {
        call "Read_XML_Part.gviweb"(Input XML=s2, Start XML Part="<Common_Information>", End XML Part="</Common_Information>", Error in=no error) -> (Output XML array=w137, Error out=w138)
        call "Exlude_WA_Entrys.gviweb"(Input XML array=w137, Error in=w138) -> (Without_WA_Entrys=w139, Output Error=w140)
        call "Interpret_Common_Information.gviweb"(Common Information Entrys=w139, Language Entrys=s3, BMKs=$"Changed Component", Error Cluster Constant=w140) -> (Startup Date and Time=w8, Device:=w141, common=w142, Boards Informations:=w143, Output Error=w144, Auto Dose=w9, Unit-type=w6)
        case (w141) {
          frame "No_Analyse.png" {
            $"wrong unit type" <- TRUE
            w145 = "Reset all"  # State
            $"Page selector" <- "Page 1"
            $"Page 1" <- 0
            w3 = w145
          }
          frame "False", Default {
            case ($"add BMK to common information") {
              frame True {
                w146 = "Update Tab View"  # State
                w3 = w146
              }
              frame False {
                w147 = "Basic Settings"  # State
                w3 = w147
              }
            }
          }
        }
        $"Device:" <- w141
        $"Board Information:" <- w143
        call "Sort_Common_Infomation.gviweb"(Error_Selektor=$Error_Selektor, Common Information=w142, Input Error=w144) -> (Output=w148, Common Information_Error=w149, Output Error=w2)
        $common <- w148
        $"Common Information_Error" <- w149
        w4 = s2
        w5 = s3
        w7 = s5
      }
      frame "Common Information iVario" {
        call "Read_XML_Part.gviweb"(Input XML=s2, Start XML Part="<Common_Information>", End XML Part="</Common_Information>", Error in=no error) -> (Output XML array=w150, Error out=w151)
        call "Exlude_WA_Entrys.gviweb"(Input XML array=w150, Error in=w151) -> (Without_WA_Entrys=w152, Output Error=w153)
        call "Interpret_Common_Information_iVario.gviweb"(Common Information Entrys=w152, Language Entrys=s3, Error Cluster Constant=w153) -> (Device:=w154, common=w155, Boards Informations:=w156, Output Error=w2, Unit-type=w6)
        case (w154) {
          frame "False", Default {
            w157 = "Basic Settings iVario"  # State
            w3 = w157
          }
          frame "No_Analyse.png" {
            $"wrong unit type" <- TRUE
            w158 = "Reset all"  # State
            w3 = w158
          }
        }
        $"Device :" <- w154
        $"common Information ivario" <- w155
        $"Boards_Information:" <- w156
        w4 = s2
        w5 = s3
        w7 = s5
        w8 = s6
        w9 = s7
      }
      frame "Basic Settings" {
        w159 = "Diagnostic RT Data Sensors"  # State
        call "Read_XML_Part.gviweb"(Input XML=s2, Start XML Part="<Basic_Settings>", End XML Part="</Basic_Settings>", Error in=no error) -> (Output XML array=w160, Error out=w161)
        call "Exlude_WA_Entrys.gviweb"(Input XML array=w160, Error in=w161) -> (Without_WA_Entrys=w162, Output Error=w163)
        call "Interpret_Basic_Settings.gviweb"(Basic Settings Entrys=w162, Config File infos=s3, Device Type=s4, Error input=w163) -> (Basic Informations=w164, Output Error=w165)
        call "Sort_Basic_Settings.gviweb"(Error_Selektor=$Error_Selektor, Basic Settings=w164, Input Error=w165) -> (Output Basic Settings=w166, Basic_Settings_Error=w167, Output Error=w2)
        $Basic_Settings <- w166
        $"add BMK to common information" <- FALSE
        $Basic_Settings_Error <- w167
        w3 = w159
        w4 = s2
        w5 = s3
        w6 = s4
        w7 = s5
        w8 = s6
        w9 = s7
      }
      frame "Basic Settings iVario" {
        w168 = "Diagnostic RT Data Sensors Heating iVario"  # State
        call "Read_XML_Part.gviweb"(Input XML=s2, Start XML Part="<Basic_Settings>", End XML Part="</Basic_Settings>", Error in=no error) -> (Output XML array=w169, Error out=w170)
        call "Exlude_WA_Entrys.gviweb"(Input XML array=w169, Error in=w170) -> (Without_WA_Entrys=w171, Output Error=w172)
        call "Exclude_iVario_Entry.gviweb"(Input XML array=w171, Excluded_Entry="Power_State_WA82", Error in=w172) -> (Without_WA_Entrys=w173, Output Error=w174)
        call "Interpret_Basic_Settings_iVario.gviweb"(Basic Settings Entrys=w173, Device Type=s4, Error input=w174) -> (Basic Informations=w175, Output Error=w2)
        $"Basic Informations" <- w175
        w3 = w168
        w4 = s2
        w5 = s3
        w6 = s4
        w7 = s5
        w8 = s6
        w9 = s7
      }
      frame "Diagnostic RT Data Sensors" {
        w176 = "DIagnostic RT Calibration"  # State
        call "Read_XML_Part.gviweb"(Input XML=s2, Start XML Part="<Diagnostic_RT_Data_Sensors>", End XML Part="</Diagnostic_RT_Data_Sensors>", Error in=no error) -> (Output XML array=w177, Error out=w178)
        call "Exlude_WA_Entrys.gviweb"(Input XML array=w177, Error in=w178) -> (Without_WA_Entrys=w179, Output Error=w180)
        # s7: Auto Dose Available
        call "Interpret_Diagnostic_RT_Data_Sensors.gviweb"(Diagnostic Settings Entrys=w179, Config File infos=s3, Device Type=s4, Error input=w180, Auto Dose=s7) -> (Diagnostic_RT_Data_Sensors=w181, Output Error=w182)
        call "Sort_Diagnostic_Real_Time_Data_Sensors.gviweb"(Error_Selektor=$Error_Selektor, Diagnostic_RT_Data_Sensors=w181, Input Error=w182) -> (Output=w183, Diagnostic Real Time Data Sensors=w184, Output Error=w2)
        $Diagnostic_RT_Data_Sensors <- w183
        $"Diagnostic Real Time Data Sensors" <- w184
        w3 = w176
        w4 = s2
        w5 = s3
        w6 = s4
        w7 = s5
        w8 = s6
        w9 = s7
      }
      frame "Diagnostic RT Data Sensors Heating iVario" {
        w185 = "Diagnostic RT Data Sensors Movement iVario"  # State
        call "Read_XML_Part.gviweb"(Input XML=s2, Start XML Part="<Diagnostic_RT_Data_Sensors_Heating>", End XML Part="</Diagnostic_RT_Data_Sensors_Heating>", Error in=no error) -> (Output XML array=w186, Error out=w187)
        Array Size(array=w186) -> (size(s)=w188)
        Is Greater Than 0(x=w188) -> w189
        case (w189) {
          frame False, Default {
            call "Read_XML_Part.gviweb"(Input XML=s2, Start XML Part="<Diagnostic_RT_Data_Sensors_(Heating)>", End XML Part="</Diagnostic_RT_Data_Sensors_(Heating)>", Error in=w187) -> (Output XML array=w191, Error out=w190)
          }
          frame True {
            w190 = w187
            w191 = w186
          }
        }
        call "Exlude_WA_Entrys.gviweb"(Input XML array=w191, Error in=w190) -> (Without_WA_Entrys=w192, Output Error=w193)
        call "Interpret_Diagnostic_RT_Data_Sensors_Heating.gviweb"(Diagnostic Settings Entrys=w192, Device Type=s4, Error input=w193) -> (Output=w194, Output Error=w2)
        $Diagnostic_RT_Data_Sensors_Heating <- w194
        w3 = w185
        w4 = s2
        w5 = s3
        w6 = s4
        w7 = s5
        w8 = s6
        w9 = s7
      }
      frame "Diagnostic RT Data Sensors Movement iVario" {
        w195 = "Diagnostic RT Data Sensors Pressure"  # State
        call "Read_XML_Part.gviweb"(Input XML=s2, Start XML Part="<Diagnostic_RT_Data_Sensors_Movement>", End XML Part="</Diagnostic_RT_Data_Sensors_Movement>", Error in=no error) -> (Output XML array=w196, Error out=w197)
        Array Size(array=w196) -> (size(s)=w198)
        Is Greater Than 0(x=w198) -> w199
        case (w199) {
          frame False, Default {
            call "Read_XML_Part.gviweb"(Input XML=s2, Start XML Part="<Diagnostic_RT_Data_Sensors_(Movement)>", End XML Part="</Diagnostic_RT_Data_Sensors_(Movement)>", Error in=w197) -> (Output XML array=w201, Error out=w200)
          }
          frame True {
            w200 = w197
            w201 = w196
          }
        }
        call "Exlude_WA_Entrys.gviweb"(Input XML array=w201, Error in=w200) -> (Without_WA_Entrys=w202, Output Error=w203)
        call "Interpret_Diagnostic_RT_Data_Sensors_Movement.gviweb"(Diagnostic Settings mouvement Entrys=w202, Device Type=s4, Error input=w203) -> (Output mouvement=w204, Output Error=w2)
        $Diagnostic_RT_Data_Sensors_mouvement <- w204
        w3 = w195
        w4 = s2
        w5 = s3
        w6 = s4
        w7 = s5
        w8 = s6
        w9 = s7
      }
      frame "Diagnostic RT Data Sensors Pressure" {
        w205 = "Diagnostic Service History iVario"  # State
        call "Read_XML_Part.gviweb"(Input XML=s2, Start XML Part="<Diagnostic_RT_Data_Sensors_Pressure>", End XML Part="</Diagnostic_RT_Data_Sensors_Pressure>", Error in=no error) -> (Output XML array=w206, Error out=w207)
        Array Size(array=w206) -> (size(s)=w208)
        Is Greater Than 0(x=w208) -> w209
        case (w209) {
          frame False, Default {
            call "Read_XML_Part.gviweb"(Input XML=s2, Start XML Part="<Diagnostic_RT_Data_Sensors_(Pressure)>", End XML Part="</Diagnostic_RT_Data_Sensors_(Pressure)>", Error in=w207) -> (Output XML array=w211, Error out=w210)
          }
          frame True {
            w210 = w207
            w211 = w206
          }
        }
        call "Exlude_WA_Entrys.gviweb"(Input XML array=w211, Error in=w210) -> (Without_WA_Entrys=w212, Output Error=w213)
        call "Interpret_Diagnostic_RT_Data_Sensors_Pressure.gviweb"(Pressure Entrys=w212, Device Type=s4, Error input=w213) -> (Output Pressure=w214, Output Error=w2)
        $Diagnostic_RT_Data_Sensors_Pressure <- w214
        w3 = w205
        w4 = s2
        w5 = s3
        w6 = s4
        w7 = s5
        w8 = s6
        w9 = s7
      }
      frame "DIagnostic RT Calibration" {
        w215 = "Diagnostic Water iCS Switch"  # State
        call "Read_XML_Part.gviweb"(Input XML=s2, Start XML Part="<Diagnostic_RT_Calibration>", End XML Part="</Diagnostic_RT_Calibration>", Error in=no error) -> (Output XML array=w216, Error out=w217)
        call "Exlude_WA_Entrys.gviweb"(Input XML array=w216, Error in=w217) -> (Without_WA_Entrys=w218, Output Error=w219)
        call "Interpret_Diagnostic_RT_Calibration.gviweb"(Diagnostic RT Calibration Entrys=w218, Error Cluster Constant=w219) -> (Diagnostic RT Calibration=w220, Calibrated=w221, Output Error=w222)
        $Checkbox <- w221
        call "Sort_Diagnostic_RT_Calibration.gviweb"(Error_Selektor=$Error_Selektor, Diagnostic RT Calibration=w220, Input Error=w222) -> (Output=w223, Diagnostic Real Time Data Sensors=w224, Output Error=w2)
        $"Diagnostic RT Calibration" <- w223
        $"Diagnostic RT Calibration_Text" <- w224
        w3 = w215
        w4 = s2
        w5 = s3
        w6 = s4
        w7 = s5
        w8 = s6
        w9 = s7
      }
      frame "Diagnostic Water iCS Switch" {
        w225 = "Diagnostic Service History"  # State
        call "Read_XML_Part.gviweb"(Input XML=s2, Start XML Part="<Diagnostic_Water_iCS_Switch>", End XML Part="</Diagnostic_Water_iCS_Switch>", Error in=no error) -> (Output XML array=w226, Error out=w227)
        call "Exlude_WA_Entrys.gviweb"(Input XML array=w226, Error in=w227) -> (Without_WA_Entrys=w228, Output Error=w229)
        call "Interpret_Diagnostic_Water_iCS_Switch.gviweb"(Diagnostic Water iCS Switch Entrys=w228, Device Type=s4, Error Cluster input=w229, Auto Dose=s7) -> (Diagnostic Water iCS Switch Output=w230, Output_Error=w231)
        call "Sort_Diagnostic_Water_iCs_Switch.gviweb"(Error_Selektor=$Error_Selektor, Diagnostic Water iCS Switch Output=w230, Input Error=w231) -> (Output=w232, Diagnostic Water iCS Switch=w233, Output Error=w2)
        $Diagnostic_Water_iCS_Switch <- w232
        $"Diagnostic Water iCS Switch Text" <- w233
        w3 = w225
        w4 = s2
        w5 = s3
        w6 = s4
        w7 = s5
        w8 = s6
        w9 = s7
      }
      frame "Diagnostic Service History" {
        w234 = "Diagnostic Running Times Modes"  # State
        call "Read_XML_Part.gviweb"(Input XML=s2, Start XML Part="<Diagnostic-Service-History>", End XML Part="</Diagnostic-Service-History>", Error in=no error) -> (Output XML array=w235, Error out=w236)
        call "Exlude_WA_Entrys.gviweb"(Input XML array=w235, Error in=w236) -> (Without_WA_Entrys=w237, Output Error=w238)
        call "Diagnostic_Service_History.gviweb"(Diagnostic Service History Entrys=w237, Device Type=s2, Error Cluster input=w238) -> (Diagnostic Service History Output=w239, Error Output=w240)
        call "Sort_Diagnostic_Service_History.gviweb"(Error_Selektor=$Error_Selektor, Diagnostic Service History Output=w239, Input Error=w240) -> (Output=w241, Diagnostic Service History Text=w242, Output Error=w2)
        $"Diagnostic-Service-History" <- w241
        $"Diagnostic Service History Text" <- w242
        w3 = w234
        w4 = s2
        w5 = s3
        w6 = s4
        w7 = s5
        w8 = s6
        w9 = s7
      }
      frame "Software Version History" {
        w243 = "Component Replacement History iCombi"  # State
        call "Read_XML_Part.gviweb"(Input XML=s2, Start XML Part="<Software-Version-History>", End XML Part="</Software-Version-History>", Error in=no error) -> (Output XML array=w244, Error out=w245)
        call "Exlude_WA_Entrys.gviweb"(Input XML array=w244, Error in=w245) -> (Without_WA_Entrys=w246, Output Error=w247)
        call "Interpret_Software_Version_History.gviweb"(Diagnostic Service History Entrys=w246, Error Cluster input=w247) -> (Software Version History=w248, Error Output=w2)
        $"Software-Service-History_iCP" <- w248
        w3 = w243
        w4 = s2
        w5 = s3
        w6 = s4
        w7 = s5
        w8 = s6
        w9 = s7
      }
      frame "System OnOff History" {
        w249 = "Common Information"  # State
        call "Read_XML_Part.gviweb"(Input XML=s2, Start XML Part="<System-OnOff-History>", End XML Part="</System-OnOff-History>", Error in=no error) -> (Output XML array=w250, Error out=w251)
        call "Exlude_WA_Entrys.gviweb"(Input XML array=w250, Error in=w251) -> (Without_WA_Entrys=w252, Output Error=w253)
        call "Interpret_System_OnOff_History.gviweb"(System OnOff History Entrys=w252, Error Cluster input=w253) -> (System OnOff History output=w254, Error Output=w2)
        $"System OnOff History" <- w254
        w3 = w249
        w4 = s2
        w5 = s3
        w6 = s4
        w7 = s5
        w8 = s6
        w9 = s7
      }
      frame "Component Replacement History iCombi" {
        w255 = "System OnOff History"  # State
        $"add BMK to common information" <- TRUE
        call "Read_XML_Part.gviweb"(Input XML=s2, Start XML Part="<Component-Replacement-History>", End XML Part="</Component-Replacement-History>", Error in=no error) -> (Output XML array=w256, Error out=w257)
        call "Exlude_WA_Entrys.gviweb"(Input XML array=w256, Error in=w257) -> (Without_WA_Entrys=w258, Output Error=w259)
        call "Interpret_Component_Replacement_History.gviweb"(Component Replacement History Entrys=w258, Error Cluster input=w259) -> (Component Replacement History=w260, Changed Component=w261, Error Output=w2)
        $"Component Replacement History" <- w260
        $"Changed Component" <- w261
        w3 = w255
        w4 = s2
        w5 = s3
        w6 = s4
        w7 = s5
        w8 = s6
        w9 = s7
      }
      frame "Software Version History iVario" {
        w262 = "Wait For Interaction"  # State
        call "Read_XML_Part.gviweb"(Input XML=s2, Start XML Part="<Software-Version-History>", End XML Part="</Software-Version-History>", Error in=no error) -> (Output XML array=w263, Error out=w264)
        call "Exlude_WA_Entrys.gviweb"(Input XML array=w263, Error in=w264) -> (Without_WA_Entrys=w265, Output Error=w266)
        call "Interpret_Software_Version_History.gviweb"(Diagnostic Service History Entrys=w265, Error Cluster input=w266) -> (Software Version History=w267, Error Output=w2)
        $"Software-Service-History_iVario" <- w267
        w3 = w262
        w4 = s2
        w5 = s3
        w6 = s4
        w7 = s5
        w8 = s6
        w9 = s7
      }
      frame "Diagnostic Service History iVario" {
        w268 = "Diagnostic Running Times Modes iVario "  # State
        call "Read_XML_Part.gviweb"(Input XML=s2, Start XML Part="<Diagnostic-Service-History>", End XML Part="</Diagnostic-Service-History>", Error in=no error) -> (Output XML array=w269, Error out=w270)
        call "Exlude_WA_Entrys.gviweb"(Input XML array=w269, Error in=w270) -> (Without_WA_Entrys=w271, Output Error=w272)
        call "Diagnostic_Service_History.gviweb"(Diagnostic Service History Entrys=w271, Device Type=s4, Error Cluster input=w272) -> (Diagnostic Service History Output=w273, Error Output=w274)
        call "Sort_Service_History_MSGs_Default.gviweb"(Diagnostic Service History input=w273, Error Cluster input=w274) -> (Diagnostic Service History output=w275, Error Output=w2)
        $"Diagnostic-Service-History_iVario" <- w275
        w3 = w268
        w4 = s2
        w5 = s3
        w6 = s4
        w7 = s5
        w8 = s6
        w9 = s7
      }
      frame "Diagnostic Running Times Comp" {
        w276 = "System Logger"  # State
        call "Read_XML_Part.gviweb"(Input XML=s2, Start XML Part="<Diagnostic-RunningTimes-Comp>", End XML Part="</Diagnostic-RunningTimes-Comp>", Error in=no error) -> (Output XML array=w277, Error out=w278)
        call "Exlude_WA_Entrys.gviweb"(Input XML array=w277, Error in=w278) -> (Without_WA_Entrys=w279, Output Error=w280)
        call "Interpret_Diagnostic_RunningTimes_Comp.gviweb"(Diagnostic Service History Entrys=w279, Total running time=s5, Error Cluster input=w280) -> (Running Time Component Output=w281, Error Cluster output=w282)
        call "Sort_RunningTimes_Components.gviweb"(Error_Selektor=$Error_Selektor, Running Time Component Output=w281, Input Error=w282) -> (Output=w283, Diagnostic Running Time Components=w284, Output Error=w2)
        $"Diagnostic Running Times Comp" <- w283
        $"Diagnostic Running Time Components" <- w284
        w3 = w276
        w4 = s2
        w5 = s3
        w6 = s4
        w7 = s5
        w8 = s6
        w9 = s7
      }
      frame "Diagnostic Running Times Component iVario " {
        w285 = "Software Version History iVario"  # State
        call "Read_XML_Part.gviweb"(Input XML=s2, Start XML Part="<Diagnostic-RunningTimes-Comp>", End XML Part="</Diagnostic-RunningTimes-Comp>", Error in=no error) -> (Output XML array=w286, Error out=w287)
        call "Exlude_WA_Entrys.gviweb"(Input XML array=w286, Error in=w287) -> (Without_WA_Entrys=w288, Output Error=w289)
        call "Interpret_Diagnostic_RunningTimes_Comp.gviweb"(Diagnostic Service History Entrys=w288, Total running time=s5, Error Cluster input=w289) -> (Running Time Component Output=w290, Error Cluster output=w2)
        $"Diagnostic Running Times Components:" <- w290
        w3 = w285
        w4 = s2
        w5 = s3
        w6 = s4
        w7 = s5
        w8 = s6
        w9 = s7
      }
      frame "System Logger" {
        w291 = "Histogram temperature CPU"  # State
        call "Read_XML_Part.gviweb"(Input XML=s2, Start XML Part="<SystemLogger>", End XML Part="</SystemLogger>", Error in=no error) -> (Output XML array=w292, Error out=w293)
        call "Exlude_WA_Entrys.gviweb"(Input XML array=w292, Error in=w293) -> (Without_WA_Entrys=w294, Output Error=w295)
        call "Interpret_SystemLogger.gviweb"(SystemLogger Entrys=w294, Startup Date and Time=s6, Error Cluster input=w295) -> (System Logger output=w296, Error Cluster output=w297)
        call "Sort_System_Logger.gviweb"(Error_Selektor=$Error_Selektor, System Logger=w296, Input Error=w297) -> (Output=w298, System Logger_2=w299, Output Error=w2)
        $"System Logger Output" <- w298
        $"System Logger_Text" <- w299
        w3 = w291
        w4 = s2
        w5 = s3
        w6 = s4
        w7 = s5
        w8 = s6
        w9 = s7
      }
      frame "Histogram temperature CPU" {
        w300 = "Histogram temperature IO"  # State
        call "Read_XML_Part.gviweb"(Input XML=s2, Start XML Part="<Histogram_cpu_pcb_-_Temperature_profile_Celsius>", End XML Part="</Histogram_cpu_pcb_-_Temperature_profile_Celsius>", Error in=no error) -> (Output XML array=w301, Error out=w302)
        call "Exlude_WA_Entrys.gviweb"(Input XML array=w301, Error in=w302) -> (Without_WA_Entrys=w303, Output Error=w304)
        call "Interpret_Histogram_CPU_IO_Temperature.gviweb"(Histogramm Entrys=w303, Error Cluster input=w304) -> (Signal=w305, Error Output=w2)
        $"Histogram cpu pcb Temperature profile Celsius" <- w305
        w3 = w300
        w4 = s2
        w5 = s3
        w6 = s4
        w7 = s5
        w8 = s6
        w9 = s7
      }
      frame "Histogram temperature IO" {
        w306 = "Histogram temperature LED hinge"  # State
        call "Read_XML_Part.gviweb"(Input XML=s2, Start XML Part="<Histogram_IO_pcb_-_Temperature_profile_Celsius>", End XML Part="</Histogram_IO_pcb_-_Temperature_profile_Celsius>", Error in=no error) -> (Output XML array=w307, Error out=w308)
        call "Exlude_WA_Entrys.gviweb"(Input XML array=w307, Error in=w308) -> (Without_WA_Entrys=w309, Output Error=w310)
        call "Interpret_Histogram_CPU_IO_Temperature.gviweb"(Histogramm Entrys=w309, Error Cluster input=w310) -> (Signal=w311, Error Output=w2)
        Array Subset(array=w311, index0=16, length0=2) -> w312
        $"Measured_temperature IO °C [Min/Max]:" <- w312
        Array Subset(array=w311, length0=16) -> w313
        $"Histogram IO Temperature profile Celsius" <- w313
        w3 = w306
        w4 = s2
        w5 = s3
        w6 = s4
        w7 = s5
        w8 = s6
        w9 = s7
      }
      frame "Histogram temperature LED hinge" {
        w314 = "Histogram temperature LED handle"  # State
        call "Read_XML_Part.gviweb"(Input XML=s2, Start XML Part="<Histogram_LED_hinge_side_-_Temperature_profile_Celsius>", End XML Part="</Histogram_LED_hinge_side_-_Temperature_profile_Celsius>", Error in=no error) -> (Output XML array=w315, Error out=w316)
        call "Exlude_WA_Entrys.gviweb"(Input XML array=w315, Error in=w316) -> (Without_WA_Entrys=w317, Output Error=w318)
        call "Interpret_Histogram_CPU_IO_Temperature.gviweb"(Histogramm Entrys=w317, Error Cluster input=w318) -> (Signal=w319, Error Output=w2)
        $"Histogram LED hinge side Temperature profile Celsius" <- w319
        w3 = w314
        w4 = s2
        w5 = s3
        w6 = s4
        w7 = s5
        w8 = s6
        w9 = s7
      }
      frame "Histogram temperature LED handle" {
        w320 = "Histogram temperature pump pcb"  # State
        call "Read_XML_Part.gviweb"(Input XML=s2, Start XML Part="<Histogram_LED_handle_side_-_Temperature_profile_Celsius>", End XML Part="</Histogram_LED_handle_side_-_Temperature_profile_Celsius>", Error in=no error) -> (Output XML array=w321, Error out=w322)
        call "Exlude_WA_Entrys.gviweb"(Input XML array=w321, Error in=w322) -> (Without_WA_Entrys=w323, Output Error=w324)
        call "Interpret_Histogram_CPU_IO_Temperature.gviweb"(Histogramm Entrys=w323, Error Cluster input=w324) -> (Signal=w325, Error Output=w2)
        $"Histogram LED handle side Temperature profile Celsius" <- w325
        w3 = w320
        w4 = s2
        w5 = s3
        w6 = s4
        w7 = s5
        w8 = s6
        w9 = s7
      }
      frame "Histogram temperature pump pcb" {
        w326 = "Histogram temperature Gas Box"  # State
        call "Read_XML_Part.gviweb"(Input XML=s2, Start XML Part="<Histogram_pump_pcb_-_Temperature_profile_Celsius>", End XML Part="</Histogram_pump_pcb_-_Temperature_profile_Celsius>", Error in=no error) -> (Output XML array=w327, Error out=w328)
        call "Exlude_WA_Entrys.gviweb"(Input XML array=w327, Error in=w328) -> (Without_WA_Entrys=w329, Output Error=w330)
        call "Interpret_Histogram_CPU_IO_Temperature.gviweb"(Histogramm Entrys=w329, Error Cluster input=w330) -> (Signal=w331, Error Output=w2)
        $"Histogram pump pcb Temperature profile Celsius" <- w331
        w3 = w326
        w4 = s2
        w5 = s3
        w6 = s4
        w7 = s5
        w8 = s6
        w9 = s7
      }
      frame "Histogram temperature Gas Box" {
        w332 = "Histogram Fan 1 RPM"  # State
        call "Read_XML_Part.gviweb"(Input XML=s2, Start XML Part="<Histogram_gas_box_-_Temperature_profile_Celsius>", End XML Part="</Histogram_gas_box_-_Temperature_profile_Celsius>", Error in=no error) -> (Output XML array=w333, Error out=w334)
        call "Exlude_WA_Entrys.gviweb"(Input XML array=w333, Error in=w334) -> (Without_WA_Entrys=w335, Output Error=w336)
        call "Interpret_Histogram_CPU_IO_Temperature.gviweb"(Histogramm Entrys=w335, Error Cluster input=w336) -> (Signal=w337, Error Output=w2)
        $"Histogram gas box Temperature profile Celsius" <- w337
        w3 = w332
        w4 = s2
        w5 = s3
        w6 = s4
        w7 = s5
        w8 = s6
        w9 = s7
      }
      frame "Histogram Fan 1 RPM" {
        w338 = "Histogram Fan 1 Power"  # State
        call "Read_XML_Part.gviweb"(Input XML=s2, Start XML Part="<Histogram_fan_1_-_RPM_profile_1_min>", End XML Part="</Histogram_fan_1_-_RPM_profile_1_min>", Error in=no error) -> (Output XML array=w339, Error out=w340)
        call "Exlude_WA_Entrys.gviweb"(Input XML array=w339, Error in=w340) -> (Without_WA_Entrys=w341, Output Error=w342)
        call "Interpret_Histogram_CPU_IO_Temperature.gviweb"(Histogramm Entrys=w341, Error Cluster input=w342) -> (Signal=w343, Error Output=w2)
        $"Histogram fan 1 RPM profile 1 min" <- w343
        w3 = w338
        w4 = s2
        w5 = s3
        w6 = s4
        w7 = s5
        w8 = s6
        w9 = s7
      }
      frame "Update Tab View" {
        Is Equal(x=$Error_Selektor, y="Error view") -> w344
        case (w344) {
          frame False, Default {
            Property Node(instance in=reference to "Tabs with errors", "Visible"=FALSE) -> (error out=w345, instance out=w346)
            Close Reference(error in=w345, reference=w346) -> (error out=w2)
          }
          frame True {
            call "Trim Whitespace.gvi"(string=$"Common Information_Error") -> (trimmed string=w347)
            call "Trim Whitespace.gvi"(string=$Basic_Settings_Error) -> (trimmed string=w348)
            call "Trim Whitespace.gvi"(string=$"Diagnostic Real Time Data Sensors") -> (trimmed string=w349)
            call "Trim Whitespace.gvi"(string=$"Diagnostic RT Calibration_Text") -> (trimmed string=w350)
            call "Trim Whitespace.gvi"(string=$"Diagnostic Water iCS Switch Text") -> (trimmed string=w351)
            call "Trim Whitespace.gvi"(string=$"Diagnostic Service History Text") -> (trimmed string=w352)
            call "Trim Whitespace.gvi"(string=$"Diagnostic Running Time Components") -> (trimmed string=w353)
            call "Trim Whitespace.gvi"(string=$"Diagnostic RunningTimes mode") -> (trimmed string=w354)
            call "Trim Whitespace.gvi"(string=$"System Logger_Text") -> (trimmed string=w355)
            Concatenate Strings("ℹ (Tab with errors):", ";", w347, ";", w348, ";", w349, ";", w350, ";", w351, ";", w352, ";", w353, ";", w354, ";", w355) -> w356
            call "Trim Whitespace.gvi"(string=w356) -> (trimmed string=w357)
            call "Search and Replace Pattern.gvi"(string=w357, pattern=";;", replace string=";", replace all=TRUE) -> (result string=w358)
            call "Search and Replace Pattern.gvi"(string=w358, pattern=";", replace string="\r\n", replace all=TRUE) -> (result string=w359)
            $"Tabs with errors" <- w359
            Property Node(instance in=reference to "Tabs with errors", "Visible"=TRUE, error in=no error) -> (error out=w360, instance out=w361)
            Close Reference(error in=w360, reference=w361) -> (error out=w2)
          }
        }
        w362 = "Wait For Interaction"  # State
        w3 = w362
        w4 = s2
        w5 = s3
        w6 = s4
        w7 = s5
        w8 = s6
        w9 = s7
      }
      frame "Histogram Fan 1 Power" {
        w363 = "Histogram Fan 1 Temperature"  # State
        call "Read_XML_Part.gviweb"(Input XML=s2, Start XML Part="<Histogram_fan_1_-_power_profile_W>", End XML Part="</Histogram_fan_1_-_power_profile_W>", Error in=no error) -> (Output XML array=w364, Error out=w365)
        call "Exlude_WA_Entrys.gviweb"(Input XML array=w364, Error in=w365) -> (Without_WA_Entrys=w366, Output Error=w367)
        call "Interpret_Histogram_CPU_IO_Temperature.gviweb"(Histogramm Entrys=w366, Error Cluster input=w367) -> (Signal=w368, Error Output=w2)
        $"Histogram fan 1 power profile W" <- w368
        w3 = w363
        w4 = s2
        w5 = s3
        w6 = s4
        w7 = s5
        w8 = s6
        w9 = s7
      }
      frame "Histogram Fan 1 Temperature" {
        w369 = "Histogram Fan 1 Voltage min"  # State
        call "Read_XML_Part.gviweb"(Input XML=s2, Start XML Part="<Histogram_fan_1_-_Temperature_profile_Celsius>", End XML Part="</Histogram_fan_1_-_Temperature_profile_Celsius>", Error in=no error) -> (Output XML array=w370, Error out=w371)
        call "Exlude_WA_Entrys.gviweb"(Input XML array=w370, Error in=w371) -> (Without_WA_Entrys=w372, Output Error=w373)
        call "Interpret_Histogram_CPU_IO_Temperature.gviweb"(Histogramm Entrys=w372, Error Cluster input=w373) -> (Signal=w374, Error Output=w2)
        $"Histogram fan 1 Temperature_profile Celsius" <- w374
        w3 = w369
        w4 = s2
        w5 = s3
        w6 = s4
        w7 = s5
        w8 = s6
        w9 = s7
      }
      frame "Histogram Fan 1 Voltage min" {
        w375 = "Histogram Fan 1 Voltage max"  # State
        call "Read_XML_Part.gviweb"(Input XML=s2, Start XML Part="<Histogram_fan_1_-_Voltage_min_V_-_1phase_3phase>", End XML Part="</Histogram_fan_1_-_Voltage_min_V_-_1phase_3phase>", Error in=no error) -> (Output XML array=w376, Error out=w377)
        call "Exlude_WA_Entrys.gviweb"(Input XML array=w376, Error in=w377) -> (Without_WA_Entrys=w378, Output Error=w379)
        call "Interpret_Histogram_CPU_IO_Temperature.gviweb"(Histogramm Entrys=w378, Error Cluster input=w379) -> (Signal=w380, Error Output=w2)
        $"Histogram fan 1 Voltage min_V_1phase_3phase" <- w380
        w3 = w375
        w4 = s2
        w5 = s3
        w6 = s4
        w7 = s5
        w8 = s6
        w9 = s7
      }
      frame "Histogram Fan 1 Voltage max" {
        w381 = "Histogram Fan 2 RPM"  # State
        call "Read_XML_Part.gviweb"(Input XML=s2, Start XML Part="<Histogram_fan_1_-_Voltage_min_V_-_1phase_3phase>", End XML Part="</Histogram_fan_1_-_Voltage_min_V_-_1phase_3phase>", Error in=no error) -> (Output XML array=w382, Error out=w383)
        call "Exlude_WA_Entrys.gviweb"(Input XML array=w382, Error in=w383) -> (Without_WA_Entrys=w384, Output Error=w385)
        call "Interpret_Histogram_CPU_IO_Temperature.gviweb"(Histogramm Entrys=w384, Error Cluster input=w385) -> (Signal=w386, Error Output=w2)
        $"Histogram fan 1 Voltage max_V_1phase_3phase" <- w386
        w3 = w381
        w4 = s2
        w5 = s3
        w6 = s4
        w7 = s5
        w8 = s6
        w9 = s7
      }
      frame "Histogram Fan 2 RPM" {
        w387 = "Histogram Fan 2 Power"  # State
        call "Read_XML_Part.gviweb"(Input XML=s2, Start XML Part="<Histogram_fan_2_-_RPM_profile_1_min>", End XML Part="</Histogram_fan_2_-_RPM_profile_1_min>", Error in=no error) -> (Output XML array=w388, Error out=w389)
        call "Exlude_WA_Entrys.gviweb"(Input XML array=w388, Error in=w389) -> (Without_WA_Entrys=w390, Output Error=w391)
        call "Interpret_Histogram_CPU_IO_Temperature.gviweb"(Histogramm Entrys=w390, Error Cluster input=w391) -> (Signal=w392, Error Output=w2)
        $"Histogram fan 2 RPM profile 1 min" <- w392
        w3 = w387
        w4 = s2
        w5 = s3
        w6 = s4
        w7 = s5
        w8 = s6
        w9 = s7
      }
      frame "Histogram Fan 2 Power" {
        w393 = "Histogram Fan 2 Temperature"  # State
        call "Read_XML_Part.gviweb"(Input XML=s2, Start XML Part="<Histogram_fan_2_-_power_profile_W>", End XML Part="</Histogram_fan_2_-_power_profile_W>", Error in=no error) -> (Output XML array=w394, Error out=w395)
        call "Exlude_WA_Entrys.gviweb"(Input XML array=w394, Error in=w395) -> (Without_WA_Entrys=w396, Output Error=w397)
        call "Interpret_Histogram_CPU_IO_Temperature.gviweb"(Histogramm Entrys=w396, Error Cluster input=w397) -> (Signal=w398, Error Output=w2)
        $"Histogram fan 2 power profile W" <- w398
        w3 = w393
        w4 = s2
        w5 = s3
        w6 = s4
        w7 = s5
        w8 = s6
        w9 = s7
      }
      frame "Histogram Fan 2 Temperature" {
        w399 = "Histogram Fan 2 Voltage min"  # State
        call "Read_XML_Part.gviweb"(Input XML=s2, Start XML Part="<Histogram_fan_2_-_Temperature_profile_Celsius>", End XML Part="</Histogram_fan_2_-_Temperature_profile_Celsius>", Error in=no error) -> (Output XML array=w400, Error out=w401)
        call "Exlude_WA_Entrys.gviweb"(Input XML array=w400, Error in=w401) -> (Without_WA_Entrys=w402, Output Error=w403)
        call "Interpret_Histogram_CPU_IO_Temperature.gviweb"(Histogramm Entrys=w402, Error Cluster input=w403) -> (Signal=w404, Error Output=w2)
        $"Histogram fan 2 Temperature_profile Celsius" <- w404
        w3 = w399
        w4 = s2
        w5 = s3
        w6 = s4
        w7 = s5
        w8 = s6
        w9 = s7
      }
      frame "Histogram Fan 2 Voltage min" {
        w405 = "Histogram Fan 2 Voltage max"  # State
        call "Read_XML_Part.gviweb"(Input XML=s2, Start XML Part="<Histogram_fan_2_-_Voltage_min_V_-_1phase_3phase>", End XML Part="</Histogram_fan_2_-_Voltage_min_V_-_1phase_3phase>", Error in=no error) -> (Output XML array=w406, Error out=w407)
        call "Exlude_WA_Entrys.gviweb"(Input XML array=w406, Error in=w407) -> (Without_WA_Entrys=w408, Output Error=w409)
        call "Interpret_Histogram_CPU_IO_Temperature.gviweb"(Histogramm Entrys=w408, Error Cluster input=w409) -> (Signal=w410, Error Output=w2)
        $"Histogram fan 2 Voltage min_V_1phase_3phase" <- w410
        w3 = w405
        w4 = s2
        w5 = s3
        w6 = s4
        w7 = s5
        w8 = s6
        w9 = s7
      }
      frame "Histogram Fan 2 Voltage max" {
        w411 = "Histogram Fan 3 RPM"  # State
        call "Read_XML_Part.gviweb"(Input XML=s2, Start XML Part="<Histogram_fan_2_-_Voltage_max_V_-_1phase_3phase>", End XML Part="</Histogram_fan_2_-_Voltage_max_V_-_1phase_3phase>", Error in=no error) -> (Output XML array=w412, Error out=w413)
        call "Exlude_WA_Entrys.gviweb"(Input XML array=w412, Error in=w413) -> (Without_WA_Entrys=w414, Output Error=w415)
        call "Interpret_Histogram_CPU_IO_Temperature.gviweb"(Histogramm Entrys=w414, Error Cluster input=w415) -> (Signal=w416, Error Output=w2)
        $"Histogram fan 2 Voltage max_V_1phase_3phase" <- w416
        w3 = w411
        w4 = s2
        w5 = s3
        w6 = s4
        w7 = s5
        w8 = s6
        w9 = s7
      }
      frame "Histogram Fan 3 RPM" {
        w417 = "Histogram Fan 3 Power"  # State
        call "Read_XML_Part.gviweb"(Input XML=s2, Start XML Part="<Histogram_fan_3_-_RPM_profile_1_min>", End XML Part="</Histogram_fan_3_-_RPM_profile_1_min>", Error in=no error) -> (Output XML array=w418, Error out=w419)
        call "Exlude_WA_Entrys.gviweb"(Input XML array=w418, Error in=w419) -> (Without_WA_Entrys=w420, Output Error=w421)
        call "Interpret_Histogram_CPU_IO_Temperature.gviweb"(Histogramm Entrys=w420, Error Cluster input=w421) -> (Signal=w422, Error Output=w2)
        $"Histogram fan 3 RPM profile 1 min" <- w422
        w3 = w417
        w4 = s2
        w5 = s3
        w6 = s4
        w7 = s5
        w8 = s6
        w9 = s7
      }
      frame "Histogram Fan 3 Power" {
        w423 = "Histogram Fan 3 Temperature"  # State
        call "Read_XML_Part.gviweb"(Input XML=s2, Start XML Part="<Histogram_fan_3_-_power_profile_W>", End XML Part="</Histogram_fan_3_-_power_profile_W>", Error in=no error) -> (Output XML array=w424, Error out=w425)
        call "Exlude_WA_Entrys.gviweb"(Input XML array=w424, Error in=w425) -> (Without_WA_Entrys=w426, Output Error=w427)
        call "Interpret_Histogram_CPU_IO_Temperature.gviweb"(Histogramm Entrys=w426, Error Cluster input=w427) -> (Signal=w428, Error Output=w2)
        $"Histogram fan 3 power profile W" <- w428
        w3 = w423
        w4 = s2
        w5 = s3
        w6 = s4
        w7 = s5
        w8 = s6
        w9 = s7
      }
      frame "Histogram Fan 3 Temperature" {
        w429 = "Histogram Fan 3 Voltage min"  # State
        call "Read_XML_Part.gviweb"(Input XML=s2, Start XML Part="<Histogram_fan_3_-_Temperature_profile_Celsius>", End XML Part="</Histogram_fan_3_-_Temperature_profile_Celsius>", Error in=no error) -> (Output XML array=w430, Error out=w431)
        call "Exlude_WA_Entrys.gviweb"(Input XML array=w430, Error in=w431) -> (Without_WA_Entrys=w432, Output Error=w433)
        call "Interpret_Histogram_CPU_IO_Temperature.gviweb"(Histogramm Entrys=w432, Error Cluster input=w433) -> (Signal=w434, Error Output=w2)
        $"Histogram fan 3 Temperature_profile Celsius" <- w434
        w3 = w429
        w4 = s2
        w5 = s3
        w6 = s4
        w7 = s5
        w8 = s6
        w9 = s7
      }
      frame "Histogram Fan 3 Voltage min" {
        w435 = "Histogram Fan 3 Voltage max"  # State
        call "Read_XML_Part.gviweb"(Input XML=s2, Start XML Part="<Histogram_fan_3_-_Voltage_min_V_-_1phase_3phase>", End XML Part="</Histogram_fan_3_-_Voltage_min_V_-_1phase_3phase>", Error in=no error) -> (Output XML array=w436, Error out=w437)
        call "Exlude_WA_Entrys.gviweb"(Input XML array=w436, Error in=w437) -> (Without_WA_Entrys=w438, Output Error=w439)
        call "Interpret_Histogram_CPU_IO_Temperature.gviweb"(Histogramm Entrys=w438, Error Cluster input=w439) -> (Signal=w440, Error Output=w2)
        $"Histogram fan 3 Voltage min_V_1phase_3phase" <- w440
        w3 = w435
        w4 = s2
        w5 = s3
        w6 = s4
        w7 = s5
        w8 = s6
        w9 = s7
      }
      frame "Histogram Fan 3 Voltage max" {
        w441 = "Histogram MMI CPU Load"  # State
        call "Read_XML_Part.gviweb"(Input XML=s2, Start XML Part="<Histogram_fan_3_-_Voltage_max_V_-_1phase_3phase>", End XML Part="</Histogram_fan_3_-_Voltage_max_V_-_1phase_3phase>", Error in=no error) -> (Output XML array=w442, Error out=w443)
        call "Exlude_WA_Entrys.gviweb"(Input XML array=w442, Error in=w443) -> (Without_WA_Entrys=w444, Output Error=w445)
        call "Interpret_Histogram_CPU_IO_Temperature.gviweb"(Histogramm Entrys=w444, Error Cluster input=w445) -> (Signal=w446, Error Output=w2)
        $"Histogram fan 3 Voltage max_V_1phase_3phase" <- w446
        w3 = w441
        w4 = s2
        w5 = s3
        w6 = s4
        w7 = s5
        w8 = s6
        w9 = s7
      }
      frame "Histogram MMI CPU Load" {
        w447 = "Histogram MMI RAM Load"  # State
        call "Read_XML_Part.gviweb"(Input XML=s2, Start XML Part="<Histogram_-_MMI_CPU_Load_Percent>", End XML Part="</Histogram_-_MMI_CPU_Load_Percent>", Error in=no error) -> (Output XML array=w448, Error out=w449)
        call "Exlude_WA_Entrys.gviweb"(Input XML array=w448, Error in=w449) -> (Without_WA_Entrys=w450, Output Error=w451)
        call "Interpret_Histogram_CPU_IO_Temperature.gviweb"(Histogramm Entrys=w450, Error Cluster input=w451) -> (Signal=w452, Error Output=w2)
        $"Histogram MMI CPU Load Percent" <- w452
        w3 = w447
        w4 = s2
        w5 = s3
        w6 = s4
        w7 = s5
        w8 = s6
        w9 = s7
      }
      frame "Histogram MMI RAM Load" {
        w453 = "Histogram Basis CPU Load"  # State
        call "Read_XML_Part.gviweb"(Input XML=s2, Start XML Part="<Histogram_-_MMI_RAM_Load_Percent>", End XML Part="</Histogram_-_MMI_RAM_Load_Percent>", Error in=no error) -> (Output XML array=w454, Error out=w455)
        call "Exlude_WA_Entrys.gviweb"(Input XML array=w454, Error in=w455) -> (Without_WA_Entrys=w456, Output Error=w457)
        call "Interpret_Histogram_CPU_IO_Temperature.gviweb"(Histogramm Entrys=w456, Error Cluster input=w457) -> (Signal=w458, Error Output=w2)
        $"Histogram MMI RAM Load Percent" <- w458
        w3 = w453
        w4 = s2
        w5 = s3
        w6 = s4
        w7 = s5
        w8 = s6
        w9 = s7
      }
      frame "Histogram Basis CPU Load" {
        w459 = "Histogram Basis RAM Load"  # State
        call "Read_XML_Part.gviweb"(Input XML=s2, Start XML Part="<Histogram_-_Basis_CPU_Load_Percent>", End XML Part="</Histogram_-_Basis_CPU_Load_Percent>", Error in=no error) -> (Output XML array=w460, Error out=w461)
        call "Exlude_WA_Entrys.gviweb"(Input XML array=w460, Error in=w461) -> (Without_WA_Entrys=w462, Output Error=w463)
        call "Interpret_Histogram_CPU_IO_Temperature.gviweb"(Histogramm Entrys=w462, Error Cluster input=w463) -> (Signal=w464, Error Output=w2)
        $"Histogram Basis CPU Load Percent" <- w464
        w3 = w459
        w4 = s2
        w5 = s3
        w6 = s4
        w7 = s5
        w8 = s6
        w9 = s7
      }
      frame "Histogram Basis RAM Load" {
        w465 = "Histogram Magnetron Top Temperature"  # State
        call "Read_XML_Part.gviweb"(Input XML=s2, Start XML Part="<Histogram_-_Basis_RAM_Load_Percent>", End XML Part="</Histogram_-_Basis_RAM_Load_Percent>", Error in=no error) -> (Output XML array=w466, Error out=w467)
        call "Exlude_WA_Entrys.gviweb"(Input XML array=w466, Error in=w467) -> (Without_WA_Entrys=w468, Output Error=w469)
        call "Interpret_Histogram_CPU_IO_Temperature.gviweb"(Histogramm Entrys=w468, Error Cluster input=w469) -> (Signal=w470, Error Output=w2)
        $"Histogram Basis RAM Load Percent" <- w470
        w3 = w465
        w4 = s2
        w5 = s3
        w6 = s4
        w7 = s5
        w8 = s6
        w9 = s7
      }
      frame "Histogram Magnetron Top Temperature" {
        w471 = "Histogram Magnetron bottomTemperature"  # State
        call "Read_XML_Part.gviweb"(Input XML=s2, Start XML Part="<Histogram_Magnetron_Top_Temperature_profile_Celsius>", End XML Part="</Histogram_Magnetron_Top_Temperature_profile_Celsius>", Error in=no error) -> (Output XML array=w472, Error out=w473)
        call "Exlude_WA_Entrys.gviweb"(Input XML array=w472, Error in=w473) -> (Without_WA_Entrys=w474, Output Error=w475)
        call "Interpret_Histogram_CPU_IO_Temperature.gviweb"(Histogramm Entrys=w474, Error Cluster input=w475) -> (Signal=w476, Error Output=w2)
        $"Histogram Magnetron Top Temperatur profile Celsius" <- w476
        w3 = w471
        w4 = s2
        w5 = s3
        w6 = s4
        w7 = s5
        w8 = s6
        w9 = s7
      }
      frame "Histogram Magnetron bottomTemperature" {
        w477 = "Histogram Power Supply Top Temperature"  # State
        call "Read_XML_Part.gviweb"(Input XML=s2, Start XML Part="<Histogram_Magnetron_bottom_Temperature_profile_Celsius>", End XML Part="</Histogram_Magnetron_bottom_Temperature_profile_Celsius>", Error in=no error) -> (Output XML array=w478, Error out=w479)
        call "Exlude_WA_Entrys.gviweb"(Input XML array=w478, Error in=w479) -> (Without_WA_Entrys=w480, Output Error=w481)
        call "Interpret_Histogram_CPU_IO_Temperature.gviweb"(Histogramm Entrys=w480, Error Cluster input=w481) -> (Signal=w482, Error Output=w2)
        $"Histogram Magnetron bottom Temperature profile Celsius" <- w482
        w3 = w477
        w4 = s2
        w5 = s3
        w6 = s4
        w7 = s5
        w8 = s6
        w9 = s7
      }
      frame "Histogram Power Supply Top Temperature" {
        w483 = "Histogram Power Supply bottom Temperature"  # State
        w484 = "</Histogram_Microwave_Power_Supply_Top_Temperature_profile_Celsius>"
        # New part name
        w485 = "<Histogram_Microwave_Power_Supply_Top_Temperature_profile_Celsius>"
        # old part name
        call "Read_XML_Part.gviweb"(Input XML=s2, Start XML Part="<Histogram_Power_Supply_Top_Temperature_profile_Celsius>", End XML Part="</Histogram_Power_Supply_Top_Temperature_profile_Celsius>", Error in=no error) -> (Output XML array=w486, Error out=w487)
        Is Empty Array(array=w486) -> w488
        case (w488) {
          frame False, Default {
            w489 = w487
            w490 = w486
          }
          frame True {
            call "Read_XML_Part.gviweb"(Input XML=s2, Start XML Part=w485, End XML Part=w484, Error in=w487) -> (Output XML array=w490, Error out=w489)
          }
        }
        call "Exlude_WA_Entrys.gviweb"(Input XML array=w490, Error in=w489) -> (Without_WA_Entrys=w491, Output Error=w492)
        call "Interpret_Histogram_CPU_IO_Temperature.gviweb"(Histogramm Entrys=w491, Error Cluster input=w492) -> (Signal=w493, Error Output=w2)
        $"Histogram Power Supply Top Temperature profile Celsius" <- w493
        w3 = w483
        w4 = s2
        w5 = s3
        w6 = s4
        w7 = s5
        w8 = s6
        w9 = s7
      }
      frame "Histogram Power Supply bottom Temperature" {
        w494 = "Software Version History"  # State
        w495 = "</Histogram_Microwave_Power_Supply_bottom_Temperature_profile_Celsius>"
        w496 = "<Histogram_Microwave_Power_Supply_bottom_Temperature_profile_Celsius>"
        w497 = "</Histogram_Power_Supply_bottom_Temperature_profile_Celsius>"
        w498 = "<Histogram_Power_Supply_bottom_Temperature_profile_Celsius>"
        call "Read_XML_Part.gviweb"(Input XML=s2, Start XML Part=w498, End XML Part=w497, Error in=no error) -> (Output XML array=w499, Error out=w500)
        Is Empty Array(array=w499) -> w501
        case (w501) {
          frame False, Default {
            w502 = w500
            w503 = w499
          }
          frame True {
            call "Read_XML_Part.gviweb"(Input XML=s2, Start XML Part=w496, End XML Part=w495, Error in=w500) -> (Output XML array=w503, Error out=w502)
          }
        }
        call "Exlude_WA_Entrys.gviweb"(Input XML array=w503, Error in=w502) -> (Without_WA_Entrys=w504, Output Error=w505)
        call "Interpret_Histogram_CPU_IO_Temperature.gviweb"(Histogramm Entrys=w504, Error Cluster input=w505) -> (Signal=w506, Error Output=w2)
        $"Histogram Power Supply bottom Temperature profile Celsius" <- w506
        w3 = w494
        w4 = s2
        w5 = s3
        w6 = s4
        w7 = s5
        w8 = s6
        w9 = s7
      }
      frame "Diagnostic Running Times Modes" {
        w507 = "Diagnostic Running Times Comp"  # State
        call "Read_XML_Part.gviweb"(Input XML=s2, Start XML Part="<Diagnostic-RunningTimes-Modes>", End XML Part="</Diagnostic-RunningTimes-Modes>", Error in=no error) -> (Output XML array=w508, Error out=w509)
        call "Exlude_WA_Entrys.gviweb"(Input XML array=w508, Error in=w509) -> (Without_WA_Entrys=w510, Output Error=w511)
        call "Interpret_Diagnostic_RunningTimes_Modes.gviweb"(Diagnostic Service History Entrys=w510, Error Cluster input=w511) -> (Diagnostic Running Time Modes Output=w512, Total running time=w7, Only Total running Time:=w513, Error Cluster output=w514)
        call "Sort_Diagnostic_RunningTimes_Modes.gviweb"(Error_Selektor=$Error_Selektor, Diagnostic Running Time Modes=w512, Input Error=w514) -> (Output=w515, Diagnostic Running Time Components=w516, Output Error=w2)
        $"Diagnostic Running Times Modes" <- w515
        $"Diagnostic RunningTimes mode" <- w516
        $"Total Running Time :" <- w513
        w3 = w507
        w4 = s2
        w5 = s3
        w6 = s4
        w8 = s6
        w9 = s7
      }
      frame "Diagnostic Running Times Modes iVario " {
        w517 = "Diagnostic Running Times Component iVario "  # State
        call "Read_XML_Part.gviweb"(Input XML=s2, Start XML Part="<Diagnostic-RunningTimes-Modes>", End XML Part="</Diagnostic-RunningTimes-Modes>", Error in=no error) -> (Output XML array=w518, Error out=w519)
        call "Exlude_WA_Entrys.gviweb"(Input XML array=w518, Error in=w519) -> (Without_WA_Entrys=w520, Output Error=w521)
        call "Interpret_Diagnostic_RunningTimes_Modes.gviweb"(Diagnostic Service History Entrys=w520, Error Cluster input=w521) -> (Total running time=w7, Only Total running Time:=w522, Error Cluster output=w2)
        $"Total Running Time:" <- w522
        w3 = w517
        w4 = s2
        w5 = s3
        w6 = s4
        w8 = s6
        w9 = s7
      }
    }
    next s1 = w3
    next s2 = w4
    next s3 = w5
    next s4 = w6
    next s5 = w7
    next s6 = w8
    next s7 = w9
    stop if FALSE
  }
